# Grasshopper definition Tower_Modules.gh (Grasshopper 1.0.7)
# Spherical spikey thing

number_slider = Slider(3, range=0..10)

# ---- group: Ground floor
srf = Surface(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)
Z = UnitZ(Factor=Slider(4.5, range=0..10))
extr = Extrude(Base=srf, Direction=Z)
preview = CustomPreview(Geometry=extr, Material=ColourSwatch(SwatchColor=RGB(255, 255, 255)))

# ---- group: Building Form
brep = Brep([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])

# ---- group: North
gene_pool = GenePool(Decimals=0, Maximum=17, Minimum=8, Value=12)
gene_pool_2 = GenePool(Decimals=0, Maximum=17, Minimum=8, Value=13)
srf_2 = Surface(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)
srf_3 = Surface(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)
srf_4 = Surface(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)
srf_5 = Surface(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)

# ----
north_north_west = GetNumber(gene_pool, AtLeast=1, AtMost=1, Maximum=1.797693135e+308, Minimum=-1.797693135e+308, TreeAccess=False)
north_north_east = GetNumber(gene_pool_2, AtLeast=1, AtMost=1, Maximum=1.797693135e+308, Minimum=-1.797693135e+308, TreeAccess=False)

# ---- group: North (continued)
series = Series(Start=0, Step=number_slider, Count=north_north_west)
series_2 = Series(Start=0, Step=number_slider, Count=north_north_west)
series_3 = Series(Start=0, Step=number_slider, Count=north_north_east)
series_4 = Series(Start=0, Step=number_slider, Count=north_north_east)
vec = VectorXYZ(XComponent=0, YComponent=0, ZComponent=series)  # -> Vector, Length
vec_2 = VectorXYZ(XComponent=0, YComponent=0, ZComponent=series_2)  # -> Vector, Length
vec_3 = VectorXYZ(XComponent=0, YComponent=0, ZComponent=series_3)  # -> Vector, Length
vec_4 = VectorXYZ(XComponent=0, YComponent=0, ZComponent=series_4)  # -> Vector, Length
move = Move(Geometry=srf_2, Motion=vec.Vector)  # -> Geometry, Transform
move_2 = Move(Geometry=srf_3, Motion=vec_2.Vector)  # -> Geometry, Transform
move_3 = Move(Geometry=srf_4, Motion=vec_3.Vector)  # -> Geometry, Transform
move_4 = Move(Geometry=srf_5, Motion=vec_4.Vector)  # -> Geometry, Transform

# ---- group: Fillet Edges and Make Closed Volumes
pt = ConstructPoint(XCoordinate=0, YCoordinate=0, ZCoordinate=Slider(3, range=0..10))
extr_2 = Extrude(Base=move_3.Geometry, Direction=pt)
cap = CapHoles(Brep=extr_2)
debrep = DeconstructBrep(Brep=cap)  # -> Faces, Edges, Vertices

pt_2 = ConstructPoint(XCoordinate=0, YCoordinate=0, ZCoordinate=Slider(3, range=0..10))
extr_3 = Extrude(Base=move.Geometry, Direction=pt_2)
cap_2 = CapHoles(Brep=extr_3)
debrep_2 = DeconstructBrep(Brep=cap_2)  # -> Faces, Edges, Vertices

pt_3 = ConstructPoint(XCoordinate=0, YCoordinate=0, ZCoordinate=Slider(3, range=0..10))
extr_4 = Extrude(Base=move_4.Geometry, Direction=pt_3)
cap_3 = CapHoles(Brep=extr_4)
debrep_3 = DeconstructBrep(Brep=cap_3)  # -> Faces, Edges, Vertices

pt_4 = ConstructPoint(XCoordinate=0, YCoordinate=0, ZCoordinate=Slider(3, range=0..10))
extr_5 = Extrude(Base=move_2.Geometry, Direction=pt_4)
cap_4 = CapHoles(Brep=extr_5)
debrep_4 = DeconstructBrep(Brep=cap_4)  # -> Faces, Edges, Vertices

# ---- group: Calculate Floor Area
area = Area(Geometry=flatten(move.Geometry))  # -> Area, Centroid
ma = MassAddition(Input=area.Area)  # -> Result, PartialResults

area_2 = Area(Geometry=flatten(move_2.Geometry))  # -> Area, Centroid
ma_2 = MassAddition(Input=area_2.Area)  # -> Result, PartialResults

area_3 = Area(Geometry=flatten(move_3.Geometry))  # -> Area, Centroid
ma_3 = MassAddition(Input=area_3.Area)  # -> Result, PartialResults

area_4 = Area(Geometry=flatten(move_4.Geometry))  # -> Area, Centroid
ma_4 = MassAddition(Input=area_4.Area)  # -> Result, PartialResults

# ---- group: Northern Circulation
entwine = Entwine(Branch00=north_north_east, Branch01=north_north_east, FlattenInputs=True)  # -> flatten(Result)
entwine_2 = Entwine(Branch00=north_north_west, Branch01=north_north_west, FlattenInputs=True)  # -> flatten(Result)
sort = SortList(Keys=entwine)  # -> Keys, ValuesA
sort_2 = SortList(Keys=entwine_2)  # -> Keys, ValuesA
item = ListItem(List=sort.Keys, Index=Slider(1, range=0..1), Wrap=True)
item_2 = ListItem(List=sort_2.Keys, Index=Slider(1, range=0..1), Wrap=True)
series_5 = Series(Start=0, Step=number_slider, Count=item)
series_6 = Series(Start=0, Step=number_slider, Count=item_2)
srf_6 = Surface(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)
srf_7 = Surface(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)
vec_5 = VectorXYZ(XComponent=0, YComponent=0, ZComponent=series_5)  # -> Vector, Length
vec_6 = VectorXYZ(XComponent=0, YComponent=0, ZComponent=series_6)  # -> Vector, Length
move_5 = Move(Geometry=srf_6, Motion=vec_5.Vector)  # -> Geometry, Transform
move_6 = Move(Geometry=srf_7, Motion=vec_6.Vector)  # -> Geometry, Transform

# ---- group: North
gene_pool_3 = GenePool(Decimals=0, Maximum=17, Minimum=8, Value=9)
gene_pool_4 = GenePool(Decimals=0, Maximum=17, Minimum=8, Value=10)
srf_8 = Surface(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)
srf_9 = Surface(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)
srf_10 = Surface(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)
srf_11 = Surface(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)

# ----
east_south_east = GetNumber(gene_pool_3, AtLeast=1, AtMost=1, Maximum=1.797693135e+308, Minimum=-1.797693135e+308, TreeAccess=False)
east_north_east = GetNumber(gene_pool_4, AtLeast=1, AtMost=1, Maximum=1.797693135e+308, Minimum=-1.797693135e+308, TreeAccess=False)

# ---- group: North (continued)
series_7 = Series(Start=0, Step=number_slider, Count=east_south_east)
series_8 = Series(Start=0, Step=number_slider, Count=east_south_east)
series_9 = Series(Start=0, Step=number_slider, Count=east_north_east)
series_10 = Series(Start=0, Step=number_slider, Count=east_north_east)
vec_7 = VectorXYZ(XComponent=0, YComponent=0, ZComponent=series_7)  # -> Vector, Length
vec_8 = VectorXYZ(XComponent=0, YComponent=0, ZComponent=series_8)  # -> Vector, Length
vec_9 = VectorXYZ(XComponent=0, YComponent=0, ZComponent=series_9)  # -> Vector, Length
vec_10 = VectorXYZ(XComponent=0, YComponent=0, ZComponent=series_10)  # -> Vector, Length
move_7 = Move(Geometry=srf_8, Motion=vec_7.Vector)  # -> Geometry, Transform
move_8 = Move(Geometry=srf_9, Motion=vec_8.Vector)  # -> Geometry, Transform
move_9 = Move(Geometry=srf_10, Motion=vec_9.Vector)  # -> Geometry, Transform
move_10 = Move(Geometry=srf_11, Motion=vec_10.Vector)  # -> Geometry, Transform

# ---- group: Fillet Edges and Make Closed Volumes
pt_5 = ConstructPoint(XCoordinate=0, YCoordinate=0, ZCoordinate=Slider(3, range=0..10))
extr_6 = Extrude(Base=move_9.Geometry, Direction=pt_5)
cap_5 = CapHoles(Brep=extr_6)
debrep_5 = DeconstructBrep(Brep=cap_5)  # -> Faces, Edges, Vertices

pt_6 = ConstructPoint(XCoordinate=0, YCoordinate=0, ZCoordinate=Slider(3, range=0..10))
extr_7 = Extrude(Base=move_7.Geometry, Direction=pt_6)
cap_6 = CapHoles(Brep=extr_7)
debrep_6 = DeconstructBrep(Brep=cap_6)  # -> Faces, Edges, Vertices

pt_7 = ConstructPoint(XCoordinate=0, YCoordinate=0, ZCoordinate=Slider(3, range=0..10))
extr_8 = Extrude(Base=move_10.Geometry, Direction=pt_7)
cap_7 = CapHoles(Brep=extr_8)
debrep_7 = DeconstructBrep(Brep=cap_7)  # -> Faces, Edges, Vertices

pt_8 = ConstructPoint(XCoordinate=0, YCoordinate=0, ZCoordinate=Slider(3, range=0..10))
extr_9 = Extrude(Base=move_8.Geometry, Direction=pt_8)
cap_8 = CapHoles(Brep=extr_9)
debrep_8 = DeconstructBrep(Brep=cap_8)  # -> Faces, Edges, Vertices

# ---- group: Calculate Floor Area
area_5 = Area(Geometry=flatten(move_7.Geometry))  # -> Area, Centroid
ma_5 = MassAddition(Input=area_5.Area)  # -> Result, PartialResults

area_6 = Area(Geometry=flatten(move_8.Geometry))  # -> Area, Centroid
ma_6 = MassAddition(Input=area_6.Area)  # -> Result, PartialResults

area_7 = Area(Geometry=flatten(move_9.Geometry))  # -> Area, Centroid
ma_7 = MassAddition(Input=area_7.Area)  # -> Result, PartialResults

area_8 = Area(Geometry=flatten(move_10.Geometry))  # -> Area, Centroid
ma_8 = MassAddition(Input=area_8.Area)  # -> Result, PartialResults

# ---- group: Easten Circulation
entwine_3 = Entwine(Branch00=east_north_east, Branch01=east_north_east, FlattenInputs=True)  # -> flatten(Result)
entwine_4 = Entwine(Branch00=east_south_east, Branch01=east_south_east, FlattenInputs=True)  # -> flatten(Result)
sort_3 = SortList(Keys=entwine_3)  # -> Keys, ValuesA
sort_4 = SortList(Keys=entwine_4)  # -> Keys, ValuesA
item_3 = ListItem(List=sort_3.Keys, Index=Slider(1, range=0..1), Wrap=True)
item_4 = ListItem(List=sort_4.Keys, Index=Slider(1, range=0..1), Wrap=True)
series_11 = Series(Start=0, Step=number_slider, Count=item_3)
series_12 = Series(Start=0, Step=number_slider, Count=item_4)
srf_12 = Surface(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)
srf_13 = Surface(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)
vec_11 = VectorXYZ(XComponent=0, YComponent=0, ZComponent=series_11)  # -> Vector, Length
vec_12 = VectorXYZ(XComponent=0, YComponent=0, ZComponent=series_12)  # -> Vector, Length
move_11 = Move(Geometry=srf_12, Motion=vec_11.Vector)  # -> Geometry, Transform
move_12 = Move(Geometry=srf_13, Motion=vec_12.Vector)  # -> Geometry, Transform

# ---- group: Cores / Core 5
entwine_5 = Entwine(Branch00=item, Branch01=item_3, FlattenInputs=True)  # -> flatten(Result)
sort_5 = SortList(Keys=entwine_5)  # -> Keys, ValuesA
item_5 = ListItem(List=sort_5.Keys, Index=Slider(1, range=0..1), Wrap=True)
series_13 = Series(Start=0, Step=number_slider, Count=item_5)
srf_14 = Surface(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)
vec_13 = VectorXYZ(XComponent=0, YComponent=0, ZComponent=series_13)  # -> Vector, Length
move_13 = Move(Geometry=srf_14, Motion=vec_13.Vector)  # -> Geometry, Transform

# ---- group: Cores / Core 6
entwine_6 = Entwine(Branch00=item_4, Branch01=item_3, FlattenInputs=True)  # -> flatten(Result)
sort_6 = SortList(Keys=entwine_6)  # -> Keys, ValuesA
item_6 = ListItem(List=sort_6.Keys, Index=Slider(1, range=0..1), Wrap=True)
series_14 = Series(Start=0, Step=number_slider, Count=item_6)
srf_15 = Surface(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)
vec_14 = VectorXYZ(XComponent=0, YComponent=0, ZComponent=series_14)  # -> Vector, Length
move_14 = Move(Geometry=srf_15, Motion=vec_14.Vector)  # -> Geometry, Transform

# ---- group: Front
gene_pool_5 = GenePool(Decimals=0, Maximum=17, Minimum=8, Value=10)
gene_pool_6 = GenePool(Decimals=0, Maximum=17, Minimum=8, Value=8)
gene_pool_7 = GenePool(Decimals=0, Maximum=17, Minimum=8, Value=9)
gene_pool_8 = GenePool(Decimals=0, Maximum=17, Minimum=8, Value=10)
srf_16 = Surface(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)
srf_17 = Surface(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)
srf_18 = Surface(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)
srf_19 = Surface(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)

# ----
south_south_east = GetNumber(gene_pool_8, AtLeast=1, AtMost=1, Maximum=1.797693135e+308, Minimum=-1.797693135e+308, TreeAccess=False)
south_south_west = GetNumber(gene_pool_7, AtLeast=1, AtMost=1, Maximum=1.797693135e+308, Minimum=-1.797693135e+308, TreeAccess=False)

# ---- group: Front (continued)
series_15 = Series(Start=0, Step=number_slider, Count=south_south_west)
series_16 = Series(Start=0, Step=number_slider, Count=south_south_east)
series_17 = Series(Start=0, Step=number_slider, Count=south_south_west)
series_18 = Series(Start=0, Step=number_slider, Count=south_south_east)
vec_15 = VectorXYZ(XComponent=0, YComponent=0, ZComponent=series_15)  # -> Vector, Length
vec_16 = VectorXYZ(XComponent=0, YComponent=0, ZComponent=series_16)  # -> Vector, Length
vec_17 = VectorXYZ(XComponent=0, YComponent=0, ZComponent=series_17)  # -> Vector, Length
vec_18 = VectorXYZ(XComponent=0, YComponent=0, ZComponent=series_18)  # -> Vector, Length
move_15 = Move(Geometry=srf_19, Motion=vec_17.Vector)  # -> Geometry, Transform
move_16 = Move(Geometry=srf_16, Motion=vec_15.Vector)  # -> Geometry, Transform
move_17 = Move(Geometry=srf_17, Motion=vec_16.Vector)  # -> Geometry, Transform
move_18 = Move(Geometry=srf_18, Motion=vec_18.Vector)  # -> Geometry, Transform

# ---- group: Fillet Edges and Make Closed Volumes
pt_9 = ConstructPoint(XCoordinate=0, YCoordinate=0, ZCoordinate=Slider(3, range=0..10))
extr_10 = Extrude(Base=move_18.Geometry, Direction=pt_9)
cap_9 = CapHoles(Brep=extr_10)
debrep_9 = DeconstructBrep(Brep=cap_9)  # -> Faces, Edges, Vertices

pt_10 = ConstructPoint(XCoordinate=0, YCoordinate=0, ZCoordinate=Slider(3, range=0..10))
extr_11 = Extrude(Base=move_17.Geometry, Direction=pt_10)
cap_10 = CapHoles(Brep=extr_11)
debrep_10 = DeconstructBrep(Brep=cap_10)  # -> Faces, Edges, Vertices

pt_11 = ConstructPoint(XCoordinate=0, YCoordinate=0, ZCoordinate=Slider(3, range=0..10))
extr_12 = Extrude(Base=move_15.Geometry, Direction=pt_11)
cap_11 = CapHoles(Brep=extr_12)
debrep_11 = DeconstructBrep(Brep=cap_11)  # -> Faces, Edges, Vertices

pt_12 = ConstructPoint(XCoordinate=0, YCoordinate=0, ZCoordinate=Slider(3, range=0..10))
extr_13 = Extrude(Base=move_16.Geometry, Direction=pt_12)
cap_12 = CapHoles(Brep=extr_13)
debrep_12 = DeconstructBrep(Brep=cap_12)  # -> Faces, Edges, Vertices

# ---- group: Calculate Floor Area
area_9 = Area(Geometry=flatten(move_17.Geometry))  # -> Area, Centroid
ma_9 = MassAddition(Input=area_9.Area)  # -> Result, PartialResults

area_10 = Area(Geometry=flatten(move_16.Geometry))  # -> Area, Centroid
ma_10 = MassAddition(Input=area_10.Area)  # -> Result, PartialResults

area_11 = Area(Geometry=flatten(move_18.Geometry))  # -> Area, Centroid
ma_11 = MassAddition(Input=area_11.Area)  # -> Result, PartialResults

area_12 = Area(Geometry=flatten(move_15.Geometry))  # -> Area, Centroid
ma_12 = MassAddition(Input=area_12.Area)  # -> Result, PartialResults

# ---- group: Southern Circulation
entwine_7 = Entwine(Branch00=south_south_west, Branch01=south_south_west, FlattenInputs=True)  # -> flatten(Result)
entwine_8 = Entwine(Branch00=south_south_east, Branch01=south_south_east, FlattenInputs=True)  # -> flatten(Result)
sort_7 = SortList(Keys=entwine_8)  # -> Keys, ValuesA
sort_8 = SortList(Keys=entwine_7)  # -> Keys, ValuesA
item_7 = ListItem(List=sort_8.Keys, Index=Slider(1, range=0..1), Wrap=True)
item_8 = ListItem(List=sort_7.Keys, Index=Slider(1, range=0..1), Wrap=True)
series_19 = Series(Start=0, Step=number_slider, Count=item_7)
series_20 = Series(Start=0, Step=number_slider, Count=item_8)
srf_20 = Surface(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)
srf_21 = Surface(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)
vec_19 = VectorXYZ(XComponent=0, YComponent=0, ZComponent=series_19)  # -> Vector, Length
vec_20 = VectorXYZ(XComponent=0, YComponent=0, ZComponent=series_20)  # -> Vector, Length
move_19 = Move(Geometry=srf_20, Motion=vec_19.Vector)  # -> Geometry, Transform
move_20 = Move(Geometry=srf_21, Motion=vec_20.Vector)  # -> Geometry, Transform

# ---- group: Cores / Core 2
entwine_9 = Entwine(Branch00=item_8, Branch01=item_4, FlattenInputs=True)  # -> flatten(Result)
sort_9 = SortList(Keys=entwine_9)  # -> Keys, ValuesA
item_9 = ListItem(List=sort_9.Keys, Index=Slider(1, range=0..1), Wrap=True)
series_21 = Series(Start=0, Step=number_slider, Count=item_9)
srf_22 = Surface(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)
vec_21 = VectorXYZ(XComponent=0, YComponent=0, ZComponent=series_21)  # -> Vector, Length
move_21 = Move(Geometry=srf_22, Motion=vec_21.Vector)  # -> Geometry, Transform

# ---- group: West
gene_pool_9 = GenePool(Decimals=0, Maximum=17, Minimum=8, Value=11)
gene_pool_10 = GenePool(Decimals=0, Maximum=17, Minimum=8, Value=8)
gene_pool_11 = GenePool(Decimals=0, Maximum=17, Minimum=8, Value=11)
gene_pool_12 = GenePool(Decimals=0, Maximum=17, Minimum=8, Value=8)
srf_23 = Surface(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)
srf_24 = Surface(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)
srf_25 = Surface(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)
srf_26 = Surface(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)

# ----
west_south_west = GetNumber(gene_pool_12, AtLeast=1, AtMost=1, Maximum=1.797693135e+308, Minimum=-1.797693135e+308, TreeAccess=False)
west_north_west = GetNumber(gene_pool_11, AtLeast=1, AtMost=1, Maximum=1.797693135e+308, Minimum=-1.797693135e+308, TreeAccess=False)

# ---- group: West (continued)
series_22 = Series(Start=0, Step=number_slider, Count=west_south_west)
series_23 = Series(Start=0, Step=number_slider, Count=west_south_west)
series_24 = Series(Start=0, Step=number_slider, Count=west_north_west)
series_25 = Series(Start=0, Step=number_slider, Count=west_north_west)
vec_22 = VectorXYZ(XComponent=0, YComponent=0, ZComponent=series_22)  # -> Vector, Length
vec_23 = VectorXYZ(XComponent=0, YComponent=0, ZComponent=series_23)  # -> Vector, Length
vec_24 = VectorXYZ(XComponent=0, YComponent=0, ZComponent=series_24)  # -> Vector, Length
vec_25 = VectorXYZ(XComponent=0, YComponent=0, ZComponent=series_25)  # -> Vector, Length
move_22 = Move(Geometry=srf_23, Motion=vec_22.Vector)  # -> Geometry, Transform
move_23 = Move(Geometry=srf_25, Motion=vec_23.Vector)  # -> Geometry, Transform
move_24 = Move(Geometry=srf_24, Motion=vec_24.Vector)  # -> Geometry, Transform
move_25 = Move(Geometry=srf_26, Motion=vec_25.Vector)  # -> Geometry, Transform

# ---- group: Fillet Edges and Make Closed Volumes
pt_13 = ConstructPoint(XCoordinate=0, YCoordinate=0, ZCoordinate=Slider(3, range=0..10))
extr_14 = Extrude(Base=move_24.Geometry, Direction=pt_13)
cap_13 = CapHoles(Brep=extr_14)
debrep_13 = DeconstructBrep(Brep=cap_13)  # -> Faces, Edges, Vertices

pt_14 = ConstructPoint(XCoordinate=0, YCoordinate=0, ZCoordinate=Slider(3, range=0..10))
extr_15 = Extrude(Base=move_22.Geometry, Direction=pt_14)
cap_14 = CapHoles(Brep=extr_15)
debrep_14 = DeconstructBrep(Brep=cap_14)  # -> Faces, Edges, Vertices

pt_15 = ConstructPoint(XCoordinate=0, YCoordinate=0, ZCoordinate=Slider(3, range=0..10))
extr_16 = Extrude(Base=move_25.Geometry, Direction=pt_15)
cap_15 = CapHoles(Brep=extr_16)
debrep_15 = DeconstructBrep(Brep=cap_15)  # -> Faces, Edges, Vertices

pt_16 = ConstructPoint(XCoordinate=0, YCoordinate=0, ZCoordinate=Slider(3, range=0..10))
extr_17 = Extrude(Base=move_23.Geometry, Direction=pt_16)
cap_16 = CapHoles(Brep=extr_17)
debrep_16 = DeconstructBrep(Brep=cap_16)  # -> Faces, Edges, Vertices

# ---- group: Calculate Floor Area
area_13 = Area(Geometry=flatten(move_22.Geometry))  # -> Area, Centroid
ma_13 = MassAddition(Input=area_13.Area)  # -> Result, PartialResults

area_14 = Area(Geometry=flatten(move_23.Geometry))  # -> Area, Centroid
ma_14 = MassAddition(Input=area_14.Area)  # -> Result, PartialResults

area_15 = Area(Geometry=flatten(move_24.Geometry))  # -> Area, Centroid
ma_15 = MassAddition(Input=area_15.Area)  # -> Result, PartialResults

area_16 = Area(Geometry=flatten(move_25.Geometry))  # -> Area, Centroid
ma_16 = MassAddition(Input=area_16.Area)  # -> Result, PartialResults

# ---- group: Western Circulation
entwine_10 = Entwine(Branch00=west_north_west, Branch01=west_north_west, FlattenInputs=True)  # -> flatten(Result)
entwine_11 = Entwine(Branch00=west_south_west, Branch01=west_south_west, FlattenInputs=True)  # -> flatten(Result)
sort_10 = SortList(Keys=entwine_10)  # -> Keys, ValuesA
sort_11 = SortList(Keys=entwine_11)  # -> Keys, ValuesA
item_10 = ListItem(List=sort_10.Keys, Index=Slider(1, range=0..1), Wrap=True)
item_11 = ListItem(List=sort_11.Keys, Index=Slider(1, range=0..1), Wrap=True)
series_26 = Series(Start=0, Step=number_slider, Count=item_10)
series_27 = Series(Start=0, Step=number_slider, Count=item_11)
srf_27 = Surface(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)
srf_28 = Surface(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)
vec_26 = VectorXYZ(XComponent=0, YComponent=0, ZComponent=series_26)  # -> Vector, Length
vec_27 = VectorXYZ(XComponent=0, YComponent=0, ZComponent=series_27)  # -> Vector, Length
move_26 = Move(Geometry=srf_27, Motion=vec_26.Vector)  # -> Geometry, Transform
move_27 = Move(Geometry=srf_28, Motion=vec_27.Vector)  # -> Geometry, Transform

# ---- group: Cores / Core 1
entwine_12 = Entwine(Branch00=item_7, Branch01=item_11, FlattenInputs=True)  # -> flatten(Result)
sort_12 = SortList(Keys=entwine_12)  # -> Keys, ValuesA
item_12 = ListItem(List=sort_12.Keys, Index=Slider(1, range=0..1), Wrap=True)
series_28 = Series(Start=0, Step=number_slider, Count=item_12)
srf_29 = Surface(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)
vec_28 = VectorXYZ(XComponent=0, YComponent=0, ZComponent=series_28)  # -> Vector, Length
move_28 = Move(Geometry=srf_29, Motion=vec_28.Vector)  # -> Geometry, Transform

# ---- group: Cores / Core 4
entwine_13 = Entwine(Branch00=item_10, Branch01=item_2, FlattenInputs=True)  # -> flatten(Result)
sort_13 = SortList(Keys=entwine_13)  # -> Keys, ValuesA
item_13 = ListItem(List=sort_13.Keys, Index=Slider(1, range=0..1), Wrap=True)
series_29 = Series(Start=0, Step=number_slider, Count=item_13)
srf_30 = Surface(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)
vec_29 = VectorXYZ(XComponent=0, YComponent=0, ZComponent=series_29)  # -> Vector, Length
move_29 = Move(Geometry=srf_30, Motion=vec_29.Vector)  # -> Geometry, Transform

# ---- group: Cores / Core 3
entwine_14 = Entwine(Branch00=item_11, Branch01=item_10, FlattenInputs=True)  # -> flatten(Result)
sort_14 = SortList(Keys=entwine_14)  # -> Keys, ValuesA
item_14 = ListItem(List=sort_14.Keys, Index=Slider(1, range=0..1), Wrap=True)
series_30 = Series(Start=0, Step=number_slider, Count=item_14)
srf_31 = Surface(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)
vec_30 = VectorXYZ(XComponent=0, YComponent=0, ZComponent=series_30)  # -> Vector, Length
move_30 = Move(Geometry=srf_31, Motion=vec_30.Vector)  # -> Geometry, Transform

# ---- group: Cores
multiplication = Multiplication(A=item_12, B=Slider(3, range=0..10))
multiplication_2 = Multiplication(A=item_9, B=Slider(3, range=0..10))
multiplication_3 = Multiplication(A=item_14, B=Slider(3, range=0..10))
multiplication_4 = Multiplication(A=item_6, B=Slider(3, range=0..10))
multiplication_5 = Multiplication(A=item_13, B=Slider(3, range=0..10))
multiplication_6 = Multiplication(A=item_5, B=Slider(3, range=0..10))
Z_2 = UnitZ(Factor=multiplication)
Z_3 = UnitZ(Factor=multiplication_2)
Z_4 = UnitZ(Factor=multiplication_4)
Z_5 = UnitZ(Factor=multiplication_3)
Z_6 = UnitZ(Factor=multiplication_5)
Z_7 = UnitZ(Factor=multiplication_6)
extr_18 = Extrude(Base=srf_22, Direction=Z_3)
extr_19 = Extrude(Base=srf_29, Direction=Z_2)
extr_20 = Extrude(Base=srf_31, Direction=Z_5)
extr_21 = Extrude(Base=srf_30, Direction=Z_6)
extr_22 = Extrude(Base=srf_14, Direction=Z_7)
extr_23 = Extrude(Base=srf_15, Direction=Z_4)

# ---- group: Circulation masses
multiplication_7 = Multiplication(A=item_8, B=Slider(3, range=0..10))
multiplication_8 = Multiplication(A=item_7, B=Slider(3, range=0..10))
multiplication_9 = Multiplication(A=item_11, B=Slider(3, range=0..10))
multiplication_10 = Multiplication(A=item_10, B=Slider(3, range=0..10))
multiplication_11 = Multiplication(A=item_3, B=Slider(3, range=0..10))
multiplication_12 = Multiplication(A=item_2, B=Slider(3, range=0..10))
multiplication_13 = Multiplication(A=item_4, B=Slider(3, range=0..10))
multiplication_14 = Multiplication(A=item, B=Slider(3, range=0..10))
Z_8 = UnitZ(Factor=multiplication_7)
Z_9 = UnitZ(Factor=multiplication_8)
Z_10 = UnitZ(Factor=multiplication_9)
Z_11 = UnitZ(Factor=multiplication_10)
Z_12 = UnitZ(Factor=multiplication_11)
Z_13 = UnitZ(Factor=multiplication_12)
Z_14 = UnitZ(Factor=multiplication_13)
Z_15 = UnitZ(Factor=multiplication_14)
extr_24 = Extrude(Base=srf_21, Direction=Z_8)
extr_25 = Extrude(Base=srf_20, Direction=Z_9)
extr_26 = Extrude(Base=srf_28, Direction=Z_10)
extr_27 = Extrude(Base=srf_27, Direction=Z_11)
extr_28 = Extrude(Base=srf_12, Direction=Z_12)
extr_29 = Extrude(Base=srf_7, Direction=Z_13)
extr_30 = Extrude(Base=srf_13, Direction=Z_14)
extr_31 = Extrude(Base=srf_6, Direction=Z_15)

# ---- group: Building Context
join = BrepJoin(Breps=[extr_21, extr_23, extr_22, extr_20, extr_18, extr_19])  # -> Breps, Closed
join_2 = BrepJoin(Breps=[extr_24, extr_25, extr_26, extr_27, extr_29, extr_31, extr_30, extr_28])  # -> Breps, Closed
join_3 = BrepJoin(Breps=[join.Breps, join_2.Breps])  # -> Breps, Closed

# ----
preview_2 = CustomPreview(Geometry=join.Breps, Material=ColourSwatch(SwatchColor=RGB(0, 0, 0)))
preview_3 = CustomPreview(Geometry=join_2.Breps, Material=ColourSwatch(SwatchColor=RGB(255, 255, 255)))
context_bake = ContextBake(Circulation=join_2.Breps)
context_bake_2 = ContextBake(Geometry=join.Breps)

# ---- group: Spearate Facade/Floors
lng = ListLength(List=debrep.Faces)
panel = Panel("2")
panel_2 = Panel("""0
1""")
item_15 = ListItem(List=debrep.Faces, Index=panel_2, Wrap=True)

# ----
subtraction = Subtraction(A=lng, B=panel)
floor_area = Number(ma_3.Result)
floors = Geometry(flatten(item_15))

# ---- group: Spearate Facade/Floors (continued)
series_31 = Series(Start=panel, Step=1, Count=subtraction)
item_16 = ListItem(List=debrep.Faces, Index=series_31, Wrap=True)
join_4 = BrepJoin(Breps=item_16)  # -> Breps, Closed

# ----
windows = Geometry(flatten(join_4.Breps))

# ---- group: Spearate Facade/Floors
lng_2 = ListLength(List=debrep_2.Faces)
panel_3 = Panel("2")
panel_4 = Panel("""0
1""")
item_17 = ListItem(List=debrep_2.Faces, Index=panel_4, Wrap=True)

lng_3 = ListLength(List=debrep_3.Faces)
panel_5 = Panel("2")
panel_6 = Panel("""0
1""")
item_18 = ListItem(List=debrep_3.Faces, Index=panel_6, Wrap=True)

# ----
subtraction_2 = Subtraction(A=lng_2, B=panel_3)
floor_area_2 = Number(ma.Result)
floors_2 = Geometry(flatten(item_17))

# ---- group: Spearate Facade/Floors (continued)
series_32 = Series(Start=panel_3, Step=1, Count=subtraction_2)
item_19 = ListItem(List=debrep_2.Faces, Index=series_32, Wrap=True)
join_5 = BrepJoin(Breps=item_19)  # -> Breps, Closed

# ----
windows_2 = Geometry(flatten(join_5.Breps))

subtraction_3 = Subtraction(A=lng_3, B=panel_5)
floor_area_3 = Number(ma_4.Result)
floors_3 = Geometry(flatten(item_18))

# ---- group: Spearate Facade/Floors (continued)
series_33 = Series(Start=panel_5, Step=1, Count=subtraction_3)
item_20 = ListItem(List=debrep_3.Faces, Index=series_33, Wrap=True)
join_6 = BrepJoin(Breps=item_20)  # -> Breps, Closed

# ----
windows_3 = Geometry(flatten(join_6.Breps))

# ---- group: Spearate Facade/Floors
lng_4 = ListLength(List=debrep_4.Faces)
panel_7 = Panel("2")
panel_8 = Panel("""0
1""")
item_21 = ListItem(List=debrep_4.Faces, Index=panel_8, Wrap=True)

# ----
subtraction_4 = Subtraction(A=lng_4, B=panel_7)
floor_area_4 = Number(ma_2.Result)
floors_4 = Geometry(flatten(item_21))

# ---- group: Spearate Facade/Floors (continued)
series_34 = Series(Start=panel_7, Step=1, Count=subtraction_4)
item_22 = ListItem(List=debrep_4.Faces, Index=series_34, Wrap=True)
join_7 = BrepJoin(Breps=item_22)  # -> Breps, Closed

# ----
windows_4 = Geometry(flatten(join_7.Breps))

# ---- group: Spearate Facade/Floors
lng_5 = ListLength(List=debrep_5.Faces)
panel_9 = Panel("2")
panel_10 = Panel("""0
1""")
item_23 = ListItem(List=debrep_5.Faces, Index=panel_10, Wrap=True)

# ----
subtraction_5 = Subtraction(A=lng_5, B=panel_9)
floor_area_5 = Number(ma_7.Result)
floors_5 = Geometry(flatten(item_23))

# ---- group: Spearate Facade/Floors (continued)
series_35 = Series(Start=panel_9, Step=1, Count=subtraction_5)
item_24 = ListItem(List=debrep_5.Faces, Index=series_35, Wrap=True)
join_8 = BrepJoin(Breps=item_24)  # -> Breps, Closed

# ----
windows_5 = Geometry(flatten(join_8.Breps))

# ---- group: Spearate Facade/Floors
lng_6 = ListLength(List=debrep_6.Faces)
panel_11 = Panel("2")
panel_12 = Panel("""0
1""")
item_25 = ListItem(List=debrep_6.Faces, Index=panel_12, Wrap=True)

lng_7 = ListLength(List=debrep_7.Faces)
panel_13 = Panel("2")
panel_14 = Panel("""0
1""")
item_26 = ListItem(List=debrep_7.Faces, Index=panel_14, Wrap=True)

# ----
subtraction_6 = Subtraction(A=lng_6, B=panel_11)
floor_area_6 = Number(ma_5.Result)
floors_6 = Geometry(flatten(item_25))

# ---- group: Spearate Facade/Floors (continued)
series_36 = Series(Start=panel_11, Step=1, Count=subtraction_6)
item_27 = ListItem(List=debrep_6.Faces, Index=series_36, Wrap=True)
join_9 = BrepJoin(Breps=item_27)  # -> Breps, Closed

# ----
windows_6 = Geometry(flatten(join_9.Breps))

subtraction_7 = Subtraction(A=lng_7, B=panel_13)
floor_area_7 = Number(ma_8.Result)
floors_7 = Geometry(flatten(item_26))

# ---- group: Spearate Facade/Floors (continued)
series_37 = Series(Start=panel_13, Step=1, Count=subtraction_7)
item_28 = ListItem(List=debrep_7.Faces, Index=series_37, Wrap=True)
join_10 = BrepJoin(Breps=item_28)  # -> Breps, Closed

# ----
windows_7 = Geometry(flatten(join_10.Breps))

# ---- group: Spearate Facade/Floors
lng_8 = ListLength(List=debrep_8.Faces)
panel_15 = Panel("2")
panel_16 = Panel("""0
1""")
item_29 = ListItem(List=debrep_8.Faces, Index=panel_16, Wrap=True)

lng_9 = ListLength(List=debrep_9.Faces)
panel_17 = Panel("2")
panel_18 = Panel("""0
1""")
item_30 = ListItem(List=debrep_9.Faces, Index=panel_18, Wrap=True)

# ----
subtraction_8 = Subtraction(A=lng_8, B=panel_15)
floor_area_8 = Number(ma_6.Result)
floors_8 = Geometry(flatten(item_29))

# ---- group: Spearate Facade/Floors (continued)
series_38 = Series(Start=panel_15, Step=1, Count=subtraction_8)
item_31 = ListItem(List=debrep_8.Faces, Index=series_38, Wrap=True)
join_11 = BrepJoin(Breps=item_31)  # -> Breps, Closed

# ----
windows_8 = Geometry(flatten(join_11.Breps))

subtraction_9 = Subtraction(A=lng_9, B=panel_17)
floor_area_9 = Number(ma_11.Result)
floors_9 = Geometry(flatten(item_30))

# ---- group: Spearate Facade/Floors (continued)
series_39 = Series(Start=panel_17, Step=1, Count=subtraction_9)
item_32 = ListItem(List=debrep_9.Faces, Index=series_39, Wrap=True)
join_12 = BrepJoin(Breps=item_32)  # -> Breps, Closed

# ----
windows_9 = Geometry(flatten(join_12.Breps))

# ---- group: Spearate Facade/Floors
lng_10 = ListLength(List=debrep_10.Faces)
panel_19 = Panel("2")
panel_20 = Panel("""0
1""")
item_33 = ListItem(List=debrep_10.Faces, Index=panel_20, Wrap=True)

lng_11 = ListLength(List=debrep_11.Faces)
panel_21 = Panel("2")
panel_22 = Panel("""0
1""")
item_34 = ListItem(List=debrep_11.Faces, Index=panel_22, Wrap=True)

# ----
subtraction_10 = Subtraction(A=lng_10, B=panel_19)
floor_area_10 = Number(ma_9.Result)
floors_10 = Geometry(flatten(item_33))

# ---- group: Spearate Facade/Floors (continued)
series_40 = Series(Start=panel_19, Step=1, Count=subtraction_10)
item_35 = ListItem(List=debrep_10.Faces, Index=series_40, Wrap=True)
join_13 = BrepJoin(Breps=item_35)  # -> Breps, Closed

# ----
windows_10 = Geometry(flatten(join_13.Breps))

subtraction_11 = Subtraction(A=lng_11, B=panel_21)
floor_area_11 = Number(ma_12.Result)
floors_11 = Geometry(flatten(item_34))

# ---- group: Spearate Facade/Floors (continued)
series_41 = Series(Start=panel_21, Step=1, Count=subtraction_11)
item_36 = ListItem(List=debrep_11.Faces, Index=series_41, Wrap=True)
join_14 = BrepJoin(Breps=item_36)  # -> Breps, Closed

# ----
windows_11 = Geometry(flatten(join_14.Breps))

# ---- group: Spearate Facade/Floors
lng_12 = ListLength(List=debrep_13.Faces)
panel_23 = Panel("2")
panel_24 = Panel("""0
1""")
item_37 = ListItem(List=debrep_13.Faces, Index=panel_24, Wrap=True)

lng_13 = ListLength(List=debrep_12.Faces)
panel_25 = Panel("2")
panel_26 = Panel("""0
1""")
item_38 = ListItem(List=debrep_12.Faces, Index=panel_26, Wrap=True)

# ----
subtraction_12 = Subtraction(A=lng_12, B=panel_23)
floor_area_12 = Number(ma_15.Result)
floors_12 = Geometry(flatten(item_37))

# ---- group: Spearate Facade/Floors (continued)
series_42 = Series(Start=panel_23, Step=1, Count=subtraction_12)
item_39 = ListItem(List=debrep_13.Faces, Index=series_42, Wrap=True)
join_15 = BrepJoin(Breps=item_39)  # -> Breps, Closed

# ----
windows_12 = Geometry(flatten(join_15.Breps))

subtraction_13 = Subtraction(A=lng_13, B=panel_25)
floor_area_13 = Number(ma_10.Result)
floors_13 = Geometry(flatten(item_38))

# ---- group: Spearate Facade/Floors (continued)
series_43 = Series(Start=panel_25, Step=1, Count=subtraction_13)
item_40 = ListItem(List=debrep_12.Faces, Index=series_43, Wrap=True)
join_16 = BrepJoin(Breps=item_40)  # -> Breps, Closed

# ----
windows_13 = Geometry(flatten(join_16.Breps))

# ---- group: Spearate Facade/Floors
lng_14 = ListLength(List=debrep_14.Faces)
panel_27 = Panel("2")
panel_28 = Panel("""0
1""")
item_41 = ListItem(List=debrep_14.Faces, Index=panel_28, Wrap=True)

lng_15 = ListLength(List=debrep_15.Faces)
panel_29 = Panel("2")
panel_30 = Panel("""0
1""")
item_42 = ListItem(List=debrep_15.Faces, Index=panel_30, Wrap=True)

# ----
subtraction_14 = Subtraction(A=lng_14, B=panel_27)
floor_area_14 = Number(ma_13.Result)
floors_14 = Geometry(flatten(item_41))

# ---- group: Spearate Facade/Floors (continued)
series_44 = Series(Start=panel_27, Step=1, Count=subtraction_14)
item_43 = ListItem(List=debrep_14.Faces, Index=series_44, Wrap=True)
join_17 = BrepJoin(Breps=item_43)  # -> Breps, Closed

# ----
windows_14 = Geometry(flatten(join_17.Breps))

subtraction_15 = Subtraction(A=lng_15, B=panel_29)
floor_area_15 = Number(ma_16.Result)
floors_15 = Geometry(flatten(item_42))

# ---- group: Spearate Facade/Floors (continued)
series_45 = Series(Start=panel_29, Step=1, Count=subtraction_15)
item_44 = ListItem(List=debrep_15.Faces, Index=series_45, Wrap=True)
join_18 = BrepJoin(Breps=item_44)  # -> Breps, Closed

# ----
windows_15 = Geometry(flatten(join_18.Breps))

# ---- group: Spearate Facade/Floors
lng_16 = ListLength(List=debrep_16.Faces)
panel_31 = Panel("2")
panel_32 = Panel("""0
1""")
item_45 = ListItem(List=debrep_16.Faces, Index=panel_32, Wrap=True)

# ----
subtraction_16 = Subtraction(A=lng_16, B=panel_31)
floor_area_16 = Number(ma_14.Result)
floors_16 = Geometry(flatten(item_45))

# ---- group: Spearate Facade/Floors (continued)
series_46 = Series(Start=panel_31, Step=1, Count=subtraction_16)
item_46 = ListItem(List=debrep_16.Faces, Index=series_46, Wrap=True)
join_19 = BrepJoin(Breps=item_46)  # -> Breps, Closed

# ----
windows_16 = Geometry(flatten(join_19.Breps))

# ---- group: Analysis Geometry
join_20 = BrepJoin(Breps=[windows_16, windows_14, windows_12, windows_15])  # -> Breps, Closed
join_21 = BrepJoin(Breps=[windows_4, windows_2, windows, windows_3])  # -> Breps, Closed
join_22 = BrepJoin(Breps=[windows_13, windows_10, windows_9, windows_11])  # -> Breps, Closed
join_23 = BrepJoin(Breps=[windows_8, windows_6, windows_5, windows_7])  # -> Breps, Closed
join_24 = BrepJoin(Breps=[join_20.Breps, join_21.Breps, join_22.Breps, join_23.Breps])  # -> Breps, Closed

# ----
geo = Geometry(join_24.Breps)
brep_edges = BrepEdges(Brep=geo)  # -> Naked, Interior, NonManifold
preview_4 = CustomPreview(Geometry=geo, Material=ColourSwatch(SwatchColor=RGB(163, 157, 157)))
preview_5 = CustomPreview(Geometry=brep_edges.Naked, Material=ColourSwatch(SwatchColor=RGB(255, 255, 255)))
context_bake_3 = ContextBake(Geometry=geo)
context_bake_4 = ContextBake(Geometry=brep_edges.Naked)
